# Requirement set Robot_Reqs (R2025b)

## 1 [R1] Forward Motion
Robot must move forward if no obstacles are detected.
Rationale: Robot must move forward if no obstacles are detected

## 2 [R2] Obstacle Detection
Robot must stop if front sensor < threshold.
Rationale: Robot must stop if front sensor < threshold.

## 3 [R3] Left Avoidance
Robot turns left if front & right blocked, left free
Rationale: Robot turns left if front & right blocked, left free.

## 4 [R4] Right Avoidance
Robot turns right if front & left blocked, right free.
Rationale: Robot turns right if front & left blocked, right free.

## 5 [R5] Stop All
If all directions blocked, robot must stop.
Rationale: If all directions blocked, robot must stop

## 6 [R6] Resume
Robot resumes movement when any path is free.
Rationale: Robot resumes movement when any path is free.

## 7 [R7] Motor Output
Each state must output valid PWM to motor block
Rationale: Each state must output valid PWM to motor block

## 8 [R8] Velocity Cap
Robot speed must not exceed 0.5 m/s.
Rationale: Robot speed must not exceed 0.5 m/s.

## 9 [R9] Kinematic Accuracy
Differential drive model must be used for motion.
Rationale: Differential drive model must be used for motion.

## 10 [R10] MIL vs SIL
SIL and MIL results must match within 5%.
Rationale: SIL and MIL results must match within 5%.

## 11 [R11] Code Constraints
Code must compile using Embedded Coder settings.
Rationale: Code must compile using Embedded Coder settings.

## 12 [R12] Coverage
Rationale: Model must reach 90% decision + condition coverage.

## 13 [R13] Logging
Rationale: Log sensor and velocity data to mat file.

## 14 [R14] Emergency Stop
Rationale: Emergency flag must override and stop robot

## 15 [R15] Battery Fault
Rationale: Stop if simulated battery voltage drops below 10V.