test file "Robot_Tests"

suite "New Test Suite 1"

  case "Test_Front_Obstacl" [baseline]
    model Robot_Controller
    pre-load callback:
      % Set Front sensor to 5 (Obstacle)
      set_param('Robot_Controller/Front_Sens', 'Value', '5');

      % Set others to Safe distances
      set_param('Robot_Controller/Left_Sens', 'Value', '20');
      set_param('Robot_Controller/Right_Sens', 'Value', '20');

  case "Test_Left_Obstacle" [baseline]
    model Robot_Controller
    pre-load callback:
      % Set Left sensor to 5 (Obstacle)
      set_param('Robot_Controller/Left_Sens', 'Value', '5');
      % Set others to Safe
      set_param('Robot_Controller/Front_Sens', 'Value', '20');
      set_param('Robot_Controller/Right_Sens', 'Value', '20');
      set_param('Robot_Controller/Estop_Sens', 'Value', '0');

  case "Test_All_Blocked" [baseline]
    model Robot_Controller
    pre-load callback:
      % Set ALL sensors to 5 (Blocked)
      set_param('Robot_Controller/Left_Sens', 'Value', '5');
      set_param('Robot_Controller/Front_Sens', 'Value', '5');
      set_param('Robot_Controller/Right_Sens', 'Value', '5');
      set_param('Robot_Controller/Estop_Sens', 'Value', '0');

  case "Test_E_Stop" [baseline]
    model Robot_Controller
    pre-load callback:
      % Trigger Emergency Stop
      set_param('Robot_Controller/Estop_Sens', 'Value', '1');

      set_param('Robot_Controller/Front_Sens', 'Value', '20');